% Simulink data dictionary AbsData.sldd

ctrl = 1
g = 32.18
I = 5
Kf = 1
m = 50
mu = [0 0.4 0.8 0.97 1 0.98 0.96 0.94 0.92 0.9 0.88 0.855 0.83 0.81 0.79 0.77 0.75 0.73 0.72 0.71 0.7]
PBmax = 1500
Rr = 1.25
slip = [0 0.05 0.1 0.15 0.2 0.25 0.3 0.35 0.4 0.45 0.5 0.55 0.6 0.65 0.7 0.75 0.8 0.85 0.9 0.95 1]
TB = 0.01
tout = [100.1; 100.2; 100.3; 100.4; 100.5; 100.6; 100.7; 100.8; 100.9; 101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 200]
v0 = 88